# Grasshopper definition finalProject.gh (Grasshopper 1.0.7)

sqgrid = Square(Plane=PlaneXY(0, 0, 0), Size=Slider(10, range=0..100), ExtentX=Slider(6, range=3..15), ExtentY=Slider(6, range=3..15))  # -> flatten(Cells), Points
explode = Explode(Curve=sqgrid.Cells, Recursive=True)  # -> Segments, Vertices
area = Area(Geometry=sqgrid.Cells)  # -> Area, graft(Centroid)
item = ListItem(List=explode.Segments, Index=0, Wrap=True)
eval = EvaluateCurve(Curve=reparameterize(item), Parameter="1")  # -> Point, Tangent, Angle
Z = UnitZ(Factor=Slider(0.82, range=0..1))
eval_2 = EvaluateCurve(Curve=reparameterize(item), Parameter="0.5")  # -> Point, Tangent, Angle
ln = Line(StartPoint=eval_2.Point, EndPoint=area.Centroid)
eval_3 = EvaluateCurve(Curve=ln, Parameter="0.6")  # -> Point, Tangent, Angle
move = Move(Geometry=eval_3.Point, Motion=Z)  # -> Geometry, Transform
ln_2 = Line(StartPoint=move.Geometry, EndPoint=eval.Point)
ln_3 = Line(StartPoint=eval.Point, EndPoint=eval_2.Point)
ln_4 = Line(StartPoint=move.Geometry, EndPoint=eval_2.Point)
pt = Point(move.Geometry)
crv = Curve(ln_2)
crv_2 = Curve(ln_3)
crv_3 = Curve(ln_4)
Z_2 = UnitZ(Factor=1)
X = UnitX(Factor=1)
rot3d = Rotate3D(Geometry=crv_3, Angle=degrees(Slider(0, range=0..52)), Center=pt, Axis=X)  # -> Geometry, Transform
pl = ConstructPlane(Origin=pt, XAxis=crv, YAxis=Z_2)
curvepoint = PointOnCurve(rot3d.Geometry, parameter=1)
sph = Sphere(Base=curvepoint, Radius=crv_2)
cir = Circle(Plane=pl, Radius=crv)
bcx = BrepCurve(Brep=sph, Curve=cir)  # -> Curves, Points
pt_2 = Point(eval.Point)
pt_3 = Point(bcx.Points)
cp = ClosestPoint(Point=pt_2, Cloud=pt_3)  # -> ClosestPoint, CPIndex, Distance
yz = YZPlane(Origin=pt)
pt_4 = Point(cp.ClosestPoint)
pdecon = Deconstruct(Point=pt_4)  # -> XComponent, YComponent, ZComponent
srf4pt = _4PointSurface(CornerA=pt, CornerB=curvepoint, CornerC=pt_4)
mirror = Mirror(Geometry=srf4pt, Plane=yz)  # -> Geometry, Transform
Z_3 = UnitZ(Factor=expr("-x", pdecon.ZComponent))
join = BrepJoin(Breps=[srf4pt, mirror.Geometry])  # -> Breps, Closed
xy = XYPlane(Origin=pt)
arrpolar = PolarArray(Geometry=join.Breps, Plane=xy, Count=Slider(3, range=0..10), Angle=6.283185307)  # -> Geometry, Transform
move_2 = Move(Geometry=arrpolar.Geometry, Motion=Z_3)  # -> Geometry, Transform
