# Grasshopper definition finalProject_autosave.gh (Grasshopper 1.0.7)

# ----
# Сells/size/number
sqgrid = Square(Plane=PlaneXY(0, 0, 0), Size=Slider(17.3, range=0..100), ExtentX=Slider(9, range=3..15), ExtentY=Slider(9, range=3..15))  # -> flatten(Cells), Points
area = Area(Geometry=sqgrid.Cells)  # -> Area, graft(Centroid)
explode = Explode(Curve=sqgrid.Cells, Recursive=True)  # -> Segments, Vertices
item = ListItem(List=explode.Segments, Index=0, Wrap=True)
eval = EvaluateCurve(Curve=reparameterize(item), Parameter="0.5")  # -> Point, Tangent, Angle
ln = Line(StartPoint=eval.Point, EndPoint=area.Centroid)
eval_2 = EvaluateCurve(Curve=ln, Parameter="0.578")  # -> Point, Tangent, Angle
eval_3 = EvaluateCurve(Curve=reparameterize(item), Parameter="1")  # -> Point, Tangent, Angle
Z = UnitZ(Factor=Slider(0.82, range=0..1))
move = Move(Geometry=eval_2.Point, Motion=Z)  # -> Geometry, Transform
ln_2 = Line(StartPoint=move.Geometry, EndPoint=eval_3.Point)
ln_3 = Line(StartPoint=eval_3.Point, EndPoint=eval.Point)
ln_4 = Line(StartPoint=move.Geometry, EndPoint=eval.Point)

# ----
# Point control
md_slider = MDSlider(
    SliderMode=0,
    slider_value=Point(0.8499644039, 0.4806064704, 0.5),
    x_domain=Domain(0, 1),
    y_domain=Domain(0, 1),
    z_domain=Domain(0, 1))
md_slider_2 = MDSlider(
    SliderMode=0,
    slider_value=Point(0.1333636801, 0.1620431611, 0.5),
    x_domain=Domain(0, 1),
    y_domain=Domain(0, 1),
    z_domain=Domain(0, 1))
bbox = BoundingBox(Content=sqgrid.Cells, Plane=PlaneXY(0, 0, 0), UnionBox=True)  # -> Box, Box_2
evalsrf = EvaluateSurface(Surface=reparameterize(bbox.Box), Point=[md_slider, md_slider_2])  # -> Point, Normal, UDirection, VDirection, Frame
cp = ClosestPoint(Point=eval_2.Point, Cloud=evalsrf.Point)  # -> ClosestPoint, CPIndex, flatten(Distance)
remap = Remap(data=cp.Distance, min=Slider(0, range=0..1), max=Slider(55.55, range=0..60))  # -> graft(R)

# ----
# Facade and mechanism
crv = Curve(ln_2)
crv_2 = Curve(ln_3)
crv_3 = Curve(ln_4)
pt = Point(move.Geometry)
Z_2 = UnitZ(Factor=1)
X = UnitX(Factor=1)
rot3d = Rotate3D(Geometry=crv_3, Angle=degrees([Slider(54.118, range=0..65), remap]), Center=pt, Axis=X)  # -> Geometry, Transform
pl = ConstructPlane(Origin=pt, XAxis=crv, YAxis=Z_2)
curvepoint = PointOnCurve(rot3d.Geometry, parameter=1)
sph = Sphere(Base=curvepoint, Radius=crv_2)
cir = Circle(Plane=pl, Radius=crv)
bcx = BrepCurve(Brep=sph, Curve=cir)  # -> Curves, Points
pt_2 = Point(eval_3.Point)
pt_3 = Point(bcx.Points)
yz = YZPlane(Origin=pt)
cp_2 = ClosestPoint(Point=pt_2, Cloud=pt_3)  # -> ClosestPoint, CPIndex, Distance
pt_4 = Point(cp_2.ClosestPoint)
srf4pt = _4PointSurface(CornerA=pt, CornerB=curvepoint, CornerC=pt_4)
mirror = Mirror(Geometry=srf4pt, Plane=yz)  # -> Geometry, Transform
pdecon = Deconstruct(Point=pt_4)  # -> XComponent, YComponent, ZComponent
join = BrepJoin(Breps=[srf4pt, mirror.Geometry])  # -> Breps, Closed
Z_3 = UnitZ(Factor=expr("-x", pdecon.ZComponent))
xy = XYPlane(Origin=pt)
arrpolar = PolarArray(Geometry=join.Breps, Plane=xy, Count=Slider(3, range=0..10), Angle=6.283185307)  # -> Geometry, Transform
move_2 = Move(Geometry=arrpolar.Geometry, Motion=Z_3)  # -> Geometry, Transform

# ----
# additional part
number_slider = Slider(164.5, range=0..164.5)
rad = Radians(Degrees=Slider(180, range=0..300))
rotate = Rotate(Geometry=move_2.Geometry, Angle=rad, Plane=PlaneXY(0, 0, 0))  # -> Geometry, Transform
X_2 = UnitX(Factor=number_slider)
move_3 = Move(Geometry=rotate.Geometry, Motion=X_2)  # -> Geometry, Transform
Y = UnitY(Factor=Slider(154, range=0..300))
move_4 = Move(Geometry=move_3.Geometry, Motion=Y)  # -> Geometry, Transform

# ==== cluster Remap: Remaps numbers
data = ClusterInput()
min = ClusterInput()
max = ClusterInput()
bnd = Bounds(Numbers=data)
dom = ConstructDomain(DomainStart=min, DomainEnd=max)
remap = RemapNumbers(Value=data, Source=bnd, Target=dom)  # -> Mapped, Clipped
R = ClusterOutput(remap.Mapped)
