# Grasshopper definition grasshopper  code.gh (Grasshopper 1.0.7)

number_slider = Slider(3, range=0..100)
number_slider_2 = Slider(30, range=0..100)
number_slider_3 = Slider(4, range=0..100)
crv = Curve(<curve referenced from the Rhino model>)
crv_2 = Curve(<curve referenced from the Rhino model>)
crv_3 = Curve(<curve referenced from the Rhino model>)
crv_4 = Curve(<curve referenced from the Rhino model>)
pipe = Pipe(Curve=crv_3, Radius=number_slider, Caps=0)
divide = DivideCurve(Curve=crv, Count=number_slider_2, Kinks=False)  # -> Points, Tangents, Parameters
divide_2 = DivideCurve(Curve=crv_2, Count=number_slider_2, Kinks=False)  # -> Points, Tangents, Parameters
divide_3 = DivideCurve(Curve=crv_4, Count=number_slider_2, Kinks=False)  # -> Points, Tangents, Parameters
divide_4 = DivideCurve(Curve=crv_3, Count=number_slider_2, Kinks=False)  # -> Points, Tangents, Parameters
pipe_2 = Pipe(Curve=crv_4, Radius=number_slider, Caps=0)
pipe_3 = Pipe(Curve=crv, Radius=number_slider_3, Caps=0)
pipe_4 = Pipe(Curve=crv_2, Radius=number_slider_3, Caps=0)
ln = Line(StartPoint=divide.Points, EndPoint=divide_4.Points)
ln_2 = Line(StartPoint=divide_4.Points, EndPoint=divide_3.Points)
ln_3 = Line(StartPoint=divide_2.Points, EndPoint=divide_3.Points)
pipe_5 = Pipe(Curve=ln, Radius=number_slider, Caps=0)
pipe_6 = Pipe(Curve=ln_2, Radius=number_slider, Caps=0)
pipe_7 = Pipe(Curve=ln_3, Radius=number_slider, Caps=0)
