# Grasshopper definition voronoi.gh (Grasshopper 1.0.7)

populate_2d = Populate2D(
    Region={Plane=PlaneXY(33.57950343, 47.90694859, 0), Size=Domain2(u=-33.59651244..33.59651244, v=-47.93559403..47.93559403)},
    Count=Slider(22, range=1..50),
    Seed=Slider(35, range=1..50))
voronoi = Voronoi(
    Points=populate_2d,
    Boundary={Plane=PlaneXY(33.58313198, 47.95383879, 0), Size=Domain2(u=-33.61548496..33.61548496, v=-47.93361733..47.93361733)},
    BruteForceOverride=False)
explode = Explode(Curve=voronoi, Recursive=True)  # -> Segments, Vertices
unit_z = UnitZ(Factor=Slider(3, range=0..3))
average = Average(Input=explode.Vertices)
polyline = PolyLine(Vertices=explode.Vertices, Closed=True)
move = Move(Geometry=average, Motion=unit_z)  # -> Geometry, Transform
fillet = Fillet(Curve=polyline, Radius=Slider(6, range=0..6))
patch = Patch(Curves=fillet, Points=move.Geometry, Spans=20, Flexibility=1, Trim=True)
scale = Scale(Geometry=fillet, Center=average, Factor=Slider(0.9, range=0..1))  # -> Geometry, Transform
loft = Loft(
    Curves=[fillet, scale.Geometry],
    Options={Adjust=False, Closed=False, LoftEnds=0, LoftSimp=0, LoftType=0, Rebuild=10, Refit=0.01})
