# Grasshopper definition quiz5.gh (Grasshopper 1.0.7)

# Main curve
rail = Rail(reparameterize(<rail referenced from the Rhino model>))

# ----
# associate shapes
# with the main curve
number_slider = Slider(0, range=0..1)
point = Point([<point referenced from the Rhino model> x3])
perp_frame = PerpFrame(Curve=rail, Parameter=[Slider(1, range=0..1), Slider(0.49, range=0..1), number_slider])
yz_plane = YZPlane(Origin=point)

# ----
# Shape of surface
sections = Sections([<sections referenced from the Rhino model> x3])
orient = Orient(Geometry=sections, Source=yz_plane, Target=perp_frame)  # -> Geometry, Transform

sweep1 = Sweep1(Rail=rail, Sections=orient.Geometry, Miter=1)

# ----
# number of plains & forms
number_slider_2 = Slider(49, range=0..100)
perp_frames = PerpFrames(Curve=rail, Count=number_slider_2, Align=True)  # -> Frames, Parameters
brep_plane = BrepPlane(Brep=sweep1, Plane=perp_frames.Frames)  # -> Curves, Points

# ----
# Surface & Move & Extrude
number_slider_3 = Slider(3.29, range=0..10)
vector = Vector(graft(perp_frames.Frames))
surface = Surface(brep_plane.Curves)
multiplication = Multiplication(A=vector, B=number_slider_3)
move = Move(Geometry=surface, Motion=expr("-x/2", multiplication))  # -> Geometry, Transform
extrude = Extrude(Base=move.Geometry, Direction=multiplication)
