# Grasshopper definition lecture.gh (Grasshopper 1.0.7)

curve = Curve([<curve referenced from the Rhino model> x400])
area = Area(Geometry=curve)  # -> Area, Centroid
unit_x = UnitX(Factor=1)
point = Point(<point referenced from the Rhino model>)
vector_2pt = Vector2Pt(PointA=point, PointB=area.Centroid, Unitize=False)  # -> Vector, Length
unit_vector = UnitVector(Vector=vector_2pt.Vector)
remap = Remap(data=vector_2pt.Length, min=0, max=1)
graph_mapper = GraphMapper(
    remap,
    x0=0,
    x1=1,
    y0=0,
    y1=1,
    container_name="Sine",
    Equation_px=[0.4776956439, 0.6075359583],
    Equation_py=[0.1838985085, 0.7200144529])
unit_z = UnitZ(Factor=Slider(6, range=0..10))
remap_2 = Remap(data=graph_mapper, min=Slider(0.1, range=0..0.1), max=Slider(0.93, range=0..1.5))
multiplication = Multiplication(A=unit_vector, B=remap_2)
orient_direction = OrientDirection(Geometry=curve, PointA=area.Centroid, DirectionA=unit_x, PointB=area.Centroid, DirectionB=multiplication)  # -> Geometry, Transform
surface = Surface(orient_direction.Geometry)
extrude = Extrude(Base=surface, Direction=unit_z)
colour_picker = ColourPicker(PickedColour=RGB(18, 233, 31))
mesh_colours = MeshColours(Mesh=extrude, Colours=colour_picker)

# ==== cluster Remap: Remaps numbers
data = ClusterInput()
min = ClusterInput()
max = ClusterInput()
bnd = Bounds(Numbers=data)
dom = ConstructDomain(DomainStart=min, DomainEnd=max)
remap = RemapNumbers(Value=data, Source=bnd, Target=dom)  # -> Mapped, Clipped
R = ClusterOutput(remap.Mapped)
