# Grasshopper definition origami.gh (Grasshopper 1.0.7)

# ----
# Rectangle
number_slider = Slider(8.5, range=0..10)
rectangle = Rectangle(Plane=PlaneXY(0, 0, 0), XSize=number_slider, YSize=number_slider, Radius=0)  # -> Rectangle, Length

number_slider_2 = Slider(0.25, range=0..0.25)
subtraction = Subtraction(A="1", B=number_slider_2)

# ----
# Divide rectangle
count_of_points = Slider(8, range=0..10)
divide_curve = DivideCurve(Curve=rectangle.Rectangle, Count=count_of_points, Kinks=False)  # -> Points, Tangents, Parameters
size_of_numbers = Slider(1, range=0..1)
point_list = PointList(Points=divide_curve.Points, Size=size_of_numbers)

list_item = ListItem(List=divide_curve.Points, Index=0, Wrap=True)  # -> Item, Item1, Item2, Item3, Item4, Item5, Item6, Item7

# ----
# Horizontal line
line = Line(StartPoint=list_item.Item3, EndPoint=list_item.Item7)

# ----
# Vertical line
line_2 = Line(StartPoint=list_item.Item1, EndPoint=list_item.Item5)

# ----
# Remap
# Center point
# Center point motion
panel = Panel("0")
construct_domain = ConstructDomain(DomainStart=panel, DomainEnd="6")
construct_domain_2 = ConstructDomain(DomainStart="0", DomainEnd="0.25")
remap_numbers = RemapNumbers(Value=number_slider_2, Source=construct_domain_2, Target=construct_domain)  # -> Mapped, Clipped
# Center point Z
area = Area(Geometry=rectangle.Rectangle)  # -> Area, Centroid
unit_z = UnitZ(Factor=remap_numbers.Mapped)
move = Move(Geometry=area.Centroid, Motion=unit_z)  # -> Geometry, Transform

construct_domain_3 = ConstructDomain(DomainStart="0", DomainEnd="0.9")
# Sliding point
line_3 = Line(StartPoint=list_item.Item2, EndPoint=area.Centroid)
remap_numbers_2 = RemapNumbers(Value=number_slider_2, Source=construct_domain_2, Target=construct_domain_3)  # -> Mapped, Clipped
evaluate_curve = EvaluateCurve(Curve=line_3, Parameter=remap_numbers_2.Mapped)  # -> Point, Tangent, Angle

evaluate_curve_2 = EvaluateCurve(Curve=line_2, Parameter=number_slider_2)  # -> Point, Tangent, Angle
evaluate_curve_3 = EvaluateCurve(Curve=line, Parameter=number_slider_2)  # -> Point, Tangent, Angle
line_4 = Line(StartPoint=list_item.Item, EndPoint=evaluate_curve_2.Point)
line_5 = Line(StartPoint=evaluate_curve_2.Point, EndPoint=list_item.Item2)
line_6 = Line(StartPoint=evaluate_curve_3.Point, EndPoint=list_item.Item4)
line_7 = Line(StartPoint=list_item.Item2, EndPoint=evaluate_curve_3.Point)

# ----
# Lower point
construct_domain_4 = ConstructDomain(DomainStart="0", DomainEnd="5")
remap_numbers_3 = RemapNumbers(Value=number_slider_2, Source=construct_domain_2, Target=construct_domain_4)  # -> Mapped, Clipped
unit_z_2 = UnitZ(Factor=remap_numbers_3.Mapped)
# Create surface & mirror& join
move_2 = Move(Geometry=evaluate_curve_2.Point, Motion=unit_z_2)  # -> Geometry, Transform

evaluate_curve_4 = EvaluateCurve(Curve=line_2, Parameter=subtraction)  # -> Point, Tangent, Angle
evaluate_curve_5 = EvaluateCurve(Curve=line, Parameter=subtraction)  # -> Point, Tangent, Angle
line_8 = Line(StartPoint=list_item.Item4, EndPoint=evaluate_curve_4.Point)
line_9 = Line(StartPoint=evaluate_curve_4.Point, EndPoint=list_item.Item6)
line_10 = Line(StartPoint=list_item.Item6, EndPoint=evaluate_curve_5.Point)
line_11 = Line(StartPoint=evaluate_curve_5.Point, EndPoint=list_item.Item)

plane_3pt = Plane3Pt(PointA=evaluate_curve.Point, PointB=area.Centroid, PointC=move.Geometry)
_4point_surface = _4PointSurface(CornerA=move.Geometry, CornerB=move_2.Geometry, CornerC=evaluate_curve.Point)
mirror = Mirror(Geometry=_4point_surface, Plane=plane_3pt)  # -> Geometry, Transform
brep_join = BrepJoin(Breps=[mirror.Geometry, _4point_surface])  # -> Breps, Closed

# ----
# Polar array
plane = Plane(area.Centroid)
polar_array = PolarArray(Geometry=brep_join.Breps, Plane=plane, Count="4", Angle=6.283185307)  # -> Geometry, Transform
