# Grasshopper definition grasshopper  pattern.gh (Grasshopper 1.0.7)

md_slider = MDSlider(
    SliderMode=0,
    slider_value=Point(0.8499725272, 0.8129239896, 0.5),
    x_domain=Domain(0, 1),
    y_domain=Domain(0, 1),
    z_domain=Domain(0, 1))
sqgrid = Square(Plane=PlaneXY(0, 0, 0), Size=Slider(12.5, range=0..100), ExtentX=Slider(9, range=3..15), ExtentY=Slider(9, range=3..15))  # -> flatten(Cells), Points
bbox = BoundingBox(Content=sqgrid.Cells, Plane=PlaneXY(0, 0, 0), UnionBox=True)  # -> Box, Box_2
evalsrf = EvaluateSurface(Surface=reparameterize(bbox.Box), Point=md_slider)  # -> Point, Normal, UDirection, VDirection, Frame
number_slider = Slider(0.81, range=0.6..0.9)
explode = Explode(Curve=sqgrid.Cells, Recursive=True)  # -> Segments, Vertices
item = ListItem(List=explode.Vertices, Index=0, Wrap=True)  # -> Item, Item1
area = Area(Geometry=sqgrid.Cells)  # -> Area, graft(Centroid)
cp = ClosestPoint(Point=area.Centroid, Cloud=evalsrf.Point)  # -> ClosestPoint, CPIndex, flatten(Distance)
ln = Line(StartPoint=area.Centroid, EndPoint=item.Item1)
item_2 = ListItem(List=explode.Segments, Index=0, Wrap=True)  # -> Item, Item1
curvepoint = PointOnCurve(item_2.Item, parameter=0.5)
number_slider_2 = Slider(0.7, range=0..1)
number_slider_3 = Slider(2.84, range=0..10)
flip = FlipCurve(Curve=item_2.Item1)  # -> Curve, Flag
ln_2 = Line(StartPoint=curvepoint, EndPoint=area.Centroid)
Z = UnitZ(Factor=1)
remap = Remap(data=cp.Distance, min=Slider(0.1, range=0..0.1), max=Slider(0.8, range=0..1))  # -> graft(R)
eval = EvaluateCurve(Curve=reparameterize(flip.Curve), Parameter=number_slider)  # -> Point, Tangent, Angle
eval_2 = EvaluateCurve(Curve=reparameterize(item_2.Item), Parameter=number_slider)  # -> Point, Tangent, Angle
X = UnitX(Factor=1)
pl = ConstructPlane(Origin=area.Centroid, XAxis=ln, YAxis=Z)
X_2 = UnitX(Factor=expr("-x", number_slider_3))
X_3 = UnitX(Factor=number_slider_3)
eval_3 = EvaluateCurve(Curve=reparameterize(ln_2), Parameter=remap)  # -> Point, Tangent, Angle
arc = ArcSED(Start=eval_2.Point, End=eval.Point, Direction=X)  # -> Arc, Plane, Radius
bzspan = BezierSpan(StartPoint=eval_3.Point, StartTangent=X_3, EndPoint=eval_2.Point, EndTangent=X_2)  # -> Curve, Length, Domain
mirror = Mirror(Geometry=bzspan.Curve, Plane=pl)  # -> Geometry, Transform
join = JoinCurves(Curves=[arc.Arc, bzspan.Curve, mirror.Geometry], Preserve=False)
arrpolar = PolarArray(Geometry=join, Plane=area.Centroid, Count=Slider(4, range=0..10), Angle=6.283185307)  # -> Geometry, Transform
join_2 = JoinCurves(Curves=arrpolar.Geometry, Preserve=False)
Z_2 = UnitZ(Factor=1)
srf = Surface(join_2)
extr = Extrude(Base=srf, Direction=Z_2)

# ==== cluster Remap: Remaps numbers
data = ClusterInput()
min = ClusterInput()
max = ClusterInput()
bnd = Bounds(Numbers=data)
dom = ConstructDomain(DomainStart=min, DomainEnd=max)
remap = RemapNumbers(Value=data, Source=bnd, Target=dom)  # -> Mapped, Clipped
R = ClusterOutput(remap.Mapped)
