# Grasshopper definition shell.gh (Grasshopper 1.0.7)

# ----
# Color
swatch = ColourSwatch(SwatchColor=RGBA(153, 153, 153, 239))
preview = CustomPreview(Material=ColourSwatch(SwatchColor=RGBA(227, 127, 127, 239)))
preview_2 = CustomPreview(Material=swatch)

# ----
# Arc Series
number_slider = Slider(68, range=0..100)
number_slider_2 = Slider(18, range=0..100)
number_slider_3 = Slider(3, range=0..10)
series = Series(Start=number_slider, Step=number_slider_3, Count=number_slider_2)

# ----
# Rotation
dom = ConstructDomain(DomainStart=0, DomainEnd=Slider(120, range=0..1000))
range = Range(Domain=dom, Steps=number_slider_2)
xz = XZPlane(Origin=Point(0, 0, 0))
rotate = Rotate(Geometry=xz, Angle=degrees(range), Plane=PlaneXY(0, 0, 0))  # -> Geometry, Transform

arc = Arc(Plane=rotate.Geometry, Radius=series, Angle=Domain(0, 3.141592654))  # -> Arc, Length

loft = Loft(Curves=arc.Arc, Options={Adjust=False, Closed=False, LoftEnds=0, LoftSimp=0, LoftType=0, Rebuild=10, Refit=0.01})
# Pipe & loft
pipe = Pipe(Curve=arc.Arc, Radius=expr("x/2", number_slider_3), Caps=0)
