# Grasshopper definition vase.gh (Grasshopper 1.0.7)

range = Range(Domain=Domain(0, 1), Steps=Slider(40, range=0..100))
graph = GraphMapper(range, x0=0, x1=1, y0=0, y1=1, container_name="Bezier", cpx=[0, 0, 1, 1], cpy=[0, 0.5573847294, 0.3615767956, 1])
graph_2 = GraphMapper(
    range,
    x0=0,
    x1=1,
    y0=0,
    y1=1,
    container_name="Sine Summation",
    Equation0_px=[0.2132754177, 0.339864552],
    Equation0_py=[0.2399563789, 0.332788229],
    Equation1_px=[0.535782516, 0.8782830834],
    Equation1_py=[0.2608985305, 0.5150524378])
graph_3 = GraphMapper(range, x0=0, x1=1, y0=0, y1=1, container_name="Bezier", cpx=[0, 0, 1, 1], cpy=[0, 0.6174068451, 0.3178732991, 1])
graph_4 = GraphMapper(range, x0=0, x1=1, y0=0, y1=1, container_name="Bezier", cpx=[0, 0, 1, 1], cpy=[0, 0.6761231422, 0.4982551932, 1])
multiplication = Multiplication(A=Slider(18.543, range=0..60), B=graph)
expression = Expression(x=graph_3, y=Slider(0.085, range=0..1), Expression="2*pi*x*y")
expression_2 = Expression(x=graph_2, y=Slider(10, range=0..10), z=graph_4, Expression="x*y*z")
expression_3 = Expression(x=range, y=Slider(0.2, range=0..1), z=Slider(79, range=0..100), Expression="x^(1/y)*z")
addition = Addition(A=multiplication, B=expression_2)
pt = PointCylindrical(BasePlane=PlaneXY(0, 0, 0), Angle=expression, Radius=addition, Elevation=expression_3)
number_slider = Slider(0.9, range=0..1)
intcrv = Interpolate(Vertices=pt, Degree=3, Periodic=False, KnotStyle=1)  # -> Curve, Length, Domain
number_slider_2 = Slider(12, range=0..30)
scale_nu = ScaleNU(Geometry=intcrv.Curve, Plane=PlaneXY(0, 0, 0), ScaleX=number_slider, ScaleY=number_slider, ScaleZ=1)  # -> Geometry, Transform
expression_4 = Expression(x=Slider(0.46, range=0..1), y=number_slider_2, Expression="(2*pi/y)*x")
rotate = Rotate(Geometry=scale_nu.Geometry, Angle=expression_4, Plane=PlaneXY(0, 0, 0))  # -> Geometry, Transform
arrpolar = PolarArray(Geometry=intcrv.Curve, Plane=PlaneXY(0, 0, 0), Count=number_slider_2, Angle=6.283185307)  # -> Geometry, Transform
arrpolar_2 = PolarArray(Geometry=rotate.Geometry, Plane=PlaneXY(0, 0, 0), Count=number_slider_2, Angle=6.283185307)  # -> Geometry, Transform
weave = Weave(Pattern=[0, 1], Stream0=arrpolar.Geometry, Stream1=arrpolar_2.Geometry, NullGaps=False)
loft = Loft(Curves=weave, Options={Adjust=False, Closed=True, LoftEnds=0, LoftSimp=0, LoftType=0, Rebuild=10, Refit=0.01})
Z = UnitZ(Factor=1)
extr = Extrude(Base=loft, Direction=Z)
